# Grasshopper definition Treliça espacial.gh (Grasshopper 1.0.7)

diâmetro_do_tubo = Slider(0.05, range=0.05..0.2)
divisão_treliça = Slider(10, range=0..10)
altura_treliça = Slider(2, range=0..10)
surface = Surface(<surface referenced from the Rhino model>)

# ---- group: Divisão da superfície
divide_domain² = DivideDomain²(Domain=surface, UCount=divisão_treliça, VCount=divisão_treliça)
isotrim = Isotrim(Surface=surface, Domain=divide_domain²)
deconstruct_brep = DeconstructBrep(Brep=isotrim)  # -> Faces, Edges, Vertices

# ---- group: Criação dos verticies inferiores da treliça
area = Area(Geometry=deconstruct_brep.Faces)  # -> Area, Centroid
evaluate_surface = EvaluateSurface(Surface=surface, Point=area.Centroid)  # -> Point, Normal, UDirection, VDirection, Frame
multiplication = Multiplication(A=evaluate_surface.Normal, B=altura_treliça)
move = Move(Geometry=area.Centroid, Motion=multiplication)  # -> Geometry, Transform

# ---- group: Criação das diagonais e dos banzos
geometry = Geometry(flatten(move.Geometry))
partition_list = PartitionList(List=geometry, Size=divisão_treliça)
flip_matrix = FlipMatrix(Data=partition_list)
polyline = PolyLine(Vertices=deconstruct_brep.Vertices, Closed=Slider(1, range=0..1))
polyline_2 = PolyLine(Vertices=partition_list, Closed=False)
line = Line(StartPoint=deconstruct_brep.Vertices, EndPoint=move.Geometry)
polyline_3 = PolyLine(Vertices=flip_matrix, Closed=False)

# ---- group: Esfera de conexões
point = Point([deconstruct_brep.Vertices, move.Geometry])
multiplication_2 = Multiplication(A=diâmetro_do_tubo, B="2.5")
sphere = Sphere(Base=point, Radius=multiplication_2)

# ---- group: Criação dos tubos
pipe = Pipe(Curve=[polyline_3, polyline_2, polyline, line], Radius=diâmetro_do_tubo, Caps=0)

# ---- group: Novos componentes
divide_domain²_2 = DivideDomain²(UCount=10, VCount=10)
partition_list_2 = PartitionList(Size=[3, 2])
area_2 = Area()  # -> Area, Centroid
isotrim_2 = Isotrim(Domain=divide_domain²_2)
polyline_4 = PolyLine(Closed=False)
evaluate_surface_2 = EvaluateSurface(Point=area_2.Centroid)  # -> Point, Normal, UDirection, VDirection, Frame
deconstruct_brep_2 = DeconstructBrep(Brep=isotrim_2)  # -> Faces, Edges, Vertices
